# Grasshopper definition ladybug_Version0.0.35_sampleFile.gh (Grasshopper 0.9.14)
# plug-ins: Python Interpreter

# ----
# 1. Download the weather file.
# You should extract the file in case it is a zip file.
download = BooleanToggle(False)
downloadepw = Ladybug_downloadEPWWeatherFile(download=download)  # -> report; plug-in component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
panel = Panel(downloadepw)

# ----
# 6-1. Customize the analysis period
slider = Slider(4, range=0..10)

let_her_fly = BooleanToggle(False)
# 2. Let the Ladybug fly!
ladybug = Ladybug_Ladybug(letItFly=let_her_fly)  # -> report; plug-in component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
panel_2 = Panel(ladybug)

# ----
# 3. Open the weather file...
open = BooleanToggle(False)
# 4. Draw sunpath
# 4.1 Overlay Hourly Data
toggle = BooleanToggle(False)
# 6. GenCumSky
# - You have to be connected to Internet
# the first time you are using this component.
runit = BooleanToggle(False)
panel_3 = Panel("a>20")
legendpar = Ladybug_LegendParameters(lowBound=Slider(0, range=0..100))  # -> report, legendPar; plug-in component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
open_weather_file = Ladybug_OpenEPWWeatherFile(open=open)  # -> report, fileAddress; plug-in component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
panel_4 = Panel(open_weather_file.fileAddress)
month = Slider(6, range=0..10)
analysisperiod = Ladybug_AnalysisPeriod(fromMonth=slider, toMonth=Slider(9, range=0..10))  # -> report, analysisPeriod; plug-in component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
series = Series(Start=1, Step=1, Count=24)
importepw = Ladybug_ImportEpw(epw_file=open_weather_file.fileAddress)  # -> report, latitude, location, dryBulbTemperature, dewPointTemperature, relativeHumidity, windSpeed, windDirection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; plug-in component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
data = Data(importepw.dryBulbTemperature)
panel_5 = Panel(importepw.report)
sunpath = Ladybug_SunPath(
    north=0,
    latitude=importepw.latitude,
    hour=flatten(series),
    day=flatten(21),
    month=flatten(12),
    timeStep=1,
    legendPar=flatten(legendpar.legendPar),
    annualSunPath=toggle)  # -> report, sunVectors, sunAltitudes, sunAzimuths, port, sunSpheresMesh, sunPathCrvs, legend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; plug-in component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
gencumulativesky = Ladybug_GenCumulativeSky(epwWeatherFile=open_weather_file.fileAddress, runIt=runit)  # -> report, genCumSkyResult; plug-in component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
panel_6 = Panel(analysisperiod.report)
analysisperiod_2 = Ladybug_AnalysisPeriod()  # -> report, analysisPeriod; plug-in component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
# 4.2 Activate this!
ln = Line(StartPoint=sunpath.sunPathCenPts, EndPoint=sunpath.sunPositions)  # disabled
geo = Geometry([sunpath.sunPathCrvs, sunpath.legend])
mesh = Mesh(sunpath.sunSpheresMesh)
loft = Loft(Curves=ln, Options={Adjust=False, Closed=False, Rebuild=10, Refit=0.01, LoftType=0, LoftEnds=0, LoftSimp=0})
cdh_hdh = Ladybug_CDH_HDH(hourlyDryBulbTemperature=flatten(importepw.dryBulbTemperature))  # -> report, hourly_coolingDegHours, hourly_heatingDegHours, daily_coolingDegHours, daily_heatingDegHours, monthly_coolingDegHours, monthly_heatingDegHours, annual_coolingDegHours, annual_heatingDegHours; plug-in component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
cdd_hdd = Ladybug_CDD_HDD(hourlyDryBulbTemperature=flatten(importepw.dryBulbTemperature))  # -> report, daily_coolingDegDays, daily_heatingDegDays, monthly_coolingDegDays, monthly_heatingDegDays, annual_coolingDegDays, annual_heatingDegDays; plug-in component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
selectandaveragedata = Ladybug_AverageData(annualHourlyData=flatten(importepw.windSpeed), analysisPeriod=flatten(analysisperiod_2.analysisPeriod))  # -> report, selHourlyData, averagedDaily, averagedMonthly, avrMonthlyPerHour; plug-in component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
panel_7 = Panel(analysisperiod_2.report)
orient2camera = Ladybug_OrientToCamera(initPosition=sunpath.sunPositions)  # -> report, orientedToCam; plug-in component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
timer = Timer(TimerInterval=50, Target=orient2camera)  # disabled
range = Range(Domain=Domain(0, 1), Steps=10)
gradient = Gradient(LowerLimit=0, UpperLimit=1, Parameter=range, stops=[0.15: RGB(255, 130, 160), 0.85: RGB(220, 0, 40)])
# 7-2. Customize the legend
slider_2 = Slider(5, range=0..10)
tag = TextTag3D(Location=orient2camera.orientedToCam, Text=sunpath.sunPositionsInfo, Size=Slider(2, range=0..10))
# 5. Draw wind-rose
toggle_2 = BooleanToggle(False)
_3dchart = Ladybug_3DChart(inputData=flatten([selectandaveragedata.selHourlyData, importepw.directNormalRadiation, importepw.diffuseHorizontalRadiation, importepw.relativeHumidity]))  # -> report, graphMesh, legend, legendBasePts; plug-in component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
# 8-2. Customize the legend
col = Colour([ColourSwatch(SwatchColor=RGB(255, 255, 255)), ColourSwatch(SwatchColor=RGB(74, 71, 71)), ColourSwatch(SwatchColor=RGB(219, 46, 46)), ColourSwatch(SwatchColor=RGB(46, 112, 219))])
separatedata = Ladybug_SeparateData(inputList=flatten(selectandaveragedata.selHourlyData))  # -> report, numbers, strings; plug-in component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
separatedata_2 = Ladybug_SeparateData(inputList=flatten(cdh_hdh.monthly_coolingDegHours))  # -> report, numbers, strings; plug-in component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
separatedata_3 = Ladybug_SeparateData(inputList=flatten(selectandaveragedata.averagedDaily))  # -> report, numbers, strings; plug-in component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
separatedata_4 = Ladybug_SeparateData(inputList=flatten(cdh_hdh.monthly_heatingDegHours))  # -> report, numbers, strings; plug-in component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
panel_8 = Panel(cdd_hdd.report)
separatedata_5 = Ladybug_SeparateData(inputList=flatten([cdd_hdd.annual_coolingDegDays, cdd_hdd.annual_heatingDegDays]))  # -> report, numbers, strings; plug-in component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
legendpar_2 = Ladybug_LegendParameters(numSegments=slider_2)  # -> report, legendPar; plug-in component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
# 9.1 Change something that you like!!
# I suggest vertical Scale!
slider_3 = Slider(2, range=0..10)
# 7-1. Change the location
pt = Point(Point(-42.48195358, -433.5586216, 0))
legendpar_3 = Ladybug_LegendParameters(customColors=flatten(gradient))  # -> report, legendPar; plug-in component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
mesh_2 = Mesh(_3dchart.graphMesh)
geo_2 = Geometry(_3dchart.legend)
# 8. Draw the sky dome
runit_2 = BooleanToggle(False)
# 7. Draw RadRose
runit_3 = BooleanToggle(False)
windrose = Ladybug_WindRose(
    north=0,
    hourlyWindDirection=flatten(importepw.windDirection),
    hourlyWindSpeed=flatten(importepw.windSpeed),
    runIt=toggle_2)  # -> report, calmRoseMesh, windRoseMesh, windRoseCrvs, windRoseCenPts, legend, legendBasePts; plug-in component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
# 8-1. Change the location
pt_2 = Point(Point(-42.48195358, -855.9633001, 0))
# 9. Draw the radiation calla lily
runit_4 = BooleanToggle(False)
bar_graph = BarGraph(separatedata.numbers, BarColor=RGB(255, 0, 90))
graph = QuickGraph(separatedata_3.numbers)
graph_2 = QuickGraph(separatedata.numbers)
graph_3 = QuickGraph([separatedata_2.numbers, separatedata_4.numbers])
panel_9 = Panel(separatedata_5.numbers)
radiationrose = Ladybug_RadiationRose(
    genCumSkyResult=flatten(gencumulativesky.genCumSkyResult),
    centerPoint=pt,
    legendPar=flatten(legendpar_2.legendPar),
    runIt=runit_3)  # -> report, radiationArrowsMesh, radRoseBaseCrvs, legend, legendBasePts, radRoseEndPts, radRoseValues; plug-in component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
radiationcallalily = Ladybug_RadiationCallaLily(north=0, genCumSkyResult=gencumulativesky.genCumSkyResult, runIt=runit_4)  # -> report, radiationLilyMesh, baseCrvs, legend, testPts, testPtsInfo, values; plug-in component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
tregenzaskydome = Ladybug_TregenzaSkyDome(
    genCumSkyResult=flatten(gencumulativesky.genCumSkyResult),
    centerPoint=pt_2,
    legendPar=flatten(legendpar_3.legendPar),
    runIt=runit_2)  # -> report, skyPatchesMesh, baseCrvs, legend, legendBasePts, skyPatchesCenPts, values; plug-in component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
mesh_3 = Mesh(windrose.calmRoseMesh)
mesh_4 = Mesh(windrose.windRoseMesh)
geo_3 = Geometry([windrose.windRoseCrvs, windrose.legend])
orient2camera_2 = Ladybug_OrientToCamera(initPosition=radiationrose.radRoseEndPts)  # -> report, orientedToCam; plug-in component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
orient2camera_3 = Ladybug_OrientToCamera(initPosition=radiationcallalily.testPts)  # -> report, orientedToCam; plug-in component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
mesh_5 = Mesh(radiationcallalily.radiationLilyMesh)
geo_4 = Geometry([radiationcallalily.baseCrvs, radiationcallalily.legend])
mesh_6 = Mesh(tregenzaskydome.skyPatchesMesh)
timer_2 = Timer(TimerInterval=50, Target=orient2camera_2)  # disabled
geo_5 = Geometry([tregenzaskydome.baseCrvs, tregenzaskydome.legend])
mesh_7 = Mesh(radiationrose.radiationArrowsMesh)
timer_3 = Timer(TimerInterval=50, Target=orient2camera_3)  # disabled
geo_6 = Geometry([radiationrose.radRoseBaseCrvs, radiationrose.legend])
tag_2 = TextTag3D(Location=orient2camera_2.orientedToCam, Text=radiationrose.radRoseValues, Size=Slider(2, range=0..10))
tag_3 = TextTag3D(Location=orient2camera_3.orientedToCam, Text=radiationcallalily.testPtsInfo, Size=Slider(2, range=0..10))
# 11-5. Try orientation study
slider_4 = Slider(90, range=0..100)
bakeit = BooleanToggle(False)
# Set the units to meters
#                             or
# Change grid size to an appropriate number for radiation/sunlight hours studies
range_2 = Range(Domain=Domain(0, 1), Steps=10)
orientationstudypar = Ladybug_OrientationStudyParameters(divisionAngle=Slider(30, range=0..100), totalAngle=slider_4, runTheStudy=bakeit)  # -> report, orientationStudyPar; plug-in component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
gradient_2 = Gradient(LowerLimit=0, UpperLimit=1, Parameter=range_2, stops=[0: RGB(255, 255, 255), 1: RGB(0, 0, 0)])
# 10-2. customize the legend location
# and colors
pt_3 = Point(Point(395.6866682, -73.50434142, 0))
# 11-2. customize the legend location
pt_4 = Point(Point(795.6866682, -73.50434142, 0))
# 10-1. bake the results
bakeit_2 = BooleanToggle(False)
# 11-1. bake the results
bakeit_3 = BooleanToggle(False)
# 10. run sunlight hours study
runit_5 = BooleanToggle(False)
# 11. run radiation study
runit_6 = BooleanToggle(False)
legendpar_4 = Ladybug_LegendParameters(legendLocation=pt_4)  # -> report, legendPar; plug-in component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
legendpar_5 = Ladybug_LegendParameters(customColors=flatten(gradient_2), legendLocation=pt_3)  # -> report, legendPar; plug-in component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
test_geometry = Brep([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])
context = Brep(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)
test_geometry_2 = Brep([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])
context_2 = Brep(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)
sunlighthoursanalysis = Ladybug_SunlightHoursAnalysis(
    geometry=flatten(test_geometry),
    context=flatten(context),
    gridSize="4",
    disFromBase="0.02",
    sunVectors=flatten(sunpath.sunVectors),
    legendPar=flatten(legendpar_5.legendPar),
    runIt=runit_5,
    bakeIt=bakeit_2)  # -> report, contextMesh, analysisMesh, testPts, testVec, port, sunlightHoursResult, sunlightHoursMesh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; plug-in component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
radiationanalysis = Ladybug_RadiationAnalysis(
    north=0,
    geometry=flatten(test_geometry_2),
    context=flatten(context_2),
    gridSize="4",
    disFromBase="0.01",
    genCumSkyResult=flatten(gencumulativesky.genCumSkyResult),
    legendPar=flatten(legendpar_4.legendPar),
    runIt=runit_6,
    bakeIt=bakeit_3,
    projectName="myProject")  # -> report, contextMesh, analysisMesh, testPts, testVec, port, radiationResult, radiationMesh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; plug-in component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
mesh_8 = Mesh(radiationanalysis.radiationMesh)
geo_7 = Geometry(radiationanalysis.radiationLegend)
mesh_9 = Mesh(sunlighthoursanalysis.sunlightHoursMesh)
geo_8 = Geometry(sunlighthoursanalysis.sunlightHoursLegend)
panel_10 = Panel(sunlighthoursanalysis.report)
panel_11 = Panel(radiationanalysis.report)
graph_4 = QuickGraph(radiationanalysis.totalRadiation)
